# Grasshopper definition RFL_collision_checker_conf.ghx (Grasshopper 1.0.7)

panel = Panel("D:\code_ws\pb_ws\compas_fab_pychoreo\scripts\test_generator\rfl_description\urdf\rfl.urdf")
panel_2 = Panel("D:\code_ws\pb_ws\compas_fab_pychoreo\scripts\test_generator\rfl_description")
boolean_toggle = BooleanToggle(True)

# ----
# Robot
load = Button()
ghpython_script = PythonScript(load=load, pkg_path=panel_2, pkg_name="rfl_description", urdf_path=panel)  # -> out, robot
# ---------- ghpython_script: Python ----------
from scriptcontext import sticky as st
import os
import compas

from compas.robots import RobotModel
from compas.robots import GithubPackageMeshLoader
from compas.robots import LocalPackageMeshLoader
from compas_fab.ghpython import RobotArtist

# Robot meshes are usually in meters
# Set a high percision to prevent parsing errors
# and configure Rhino itself in meters
compas.PRECISION = '12f'

# Store robot in component-based key
robot_key = 'robot_{}'.format(str(ghenv.Component.InstanceGuid))

if robot_key not in st:
    st[robot_key] = None

if load:
#    # Load robot (try other repo/package combinations, e.g. 'abb_irb120_support')
#    repo    = 'ros-industrial/abb'
#    package = 'abb_irb6600_support'
#    branch  = 'kinetic-devel'
#
#    github = GithubPackageMeshLoader(repo, package, branch)
#
#    robot = RobotModel.from_urdf_file(github.load_urdf('irb6640.urdf'))
#    robot.load_geometry(github)
#    robot.artist = RobotArtist(robot)

    # Create robot model from URDF
    robot = RobotModel.from_urdf_file(urdf_path)
    
    # Also load geometry
    loader = LocalPackageMeshLoader(pkg_path, pkg_name)
    robot.load_geometry(loader)
    robot.artist = RobotArtist(robot)

    st[robot_key] = robot

robot = st[robot_key]
# ---------- end ghpython_script ----------
robot = Data(ghpython_script.robot)

# ---- group: fixed
robot_11_pickup_config = Panel("""0.0
-4900.0
0.0
-80.0
65.0
65.0
20.0
-20.0""")

# ----
a1 = Slider(7, range=-360..360)
a2 = Slider(-52, range=-360..360)
a4 = Slider(-8, range=-360..360)
a5 = Slider(41, range=-360..360)
a3 = Slider(4, range=-360..360)
a6 = Slider(0, range=-360..360)
gantry_x = Slider(22330, range=20500..26000)
ea_y = Slider(-4.758, range=-12.237..-2.587)
ea_z = Slider(-3.709, range=-4.915..-1.005)
robot_12_pickup_config = Panel("""-4056.0883789999998
-4000.8486330000001
0.0
-22.834741999999999
-30.711554
0.0
57.335655000000003
0.0""")
robot_12_pickup_config_2 = Panel("""-4056.088379
-4000.848633
0
-22.834742
-30.711554
0
57.335655
0""")
merge = Merge(Data1=a1, Data2=a2, Data3=a3, Data4=a4, Data5=a5, Data6=a6)
merge_2 = Merge(Data1=ea_y, Data2=ea_z)
merge_3 = Merge(Data1=gantry_x, Data2=robot_11_pickup_config)  # -> flatten(Result)
multiplication = Multiplication(A=merge_2, B=1000)
merge_4 = Merge(Data1=multiplication, Data2=merge)
python_script = PythonScript(robot11=merge_3, robot12=merge_4)  # -> out, c; inputs robot11: list, robot12: list
# ---------- python_script: Python ----------
from compas_fab.robots import Configuration
from math import radians as rad

print robot11
print robot12

start_full_configuration = Configuration(
    values = (
        robot11[0],
        robot11[1], robot11[2],
        rad(robot11[3]), rad(robot11[4]), rad(robot11[5]), rad(robot11[6]), rad(robot11[7]), rad(robot11[8]),
        robot12[0], robot12[1],
        rad(robot12[2]), rad(robot12[3]), rad(robot12[4]), rad(robot12[5]), rad(robot12[6]), rad(robot12[7]),
        38000,
        0, -4915,
        0, 0, 0, 0, 0, 0,
        -12237, -4915,
        0, 0, 0, 0, 0, 0
        ),
    types = (
        2,
        2, 2,
        0, 0, 0, 0, 0, 0,
        2, 2,
        0, 0, 0, 0, 0, 0,
        2,
        2, 2,
        0, 0, 0, 0, 0, 0,
        2, 2,
        0, 0, 0, 0, 0, 0
        ),
    joint_names = (
        'bridge1_joint_EA_X',
        'robot11_joint_EA_Y', 'robot11_joint_EA_Z',
        'robot11_joint_1', 'robot11_joint_2', 'robot11_joint_3', 'robot11_joint_4', 'robot11_joint_5', 'robot11_joint_6',
        'robot12_joint_EA_Y', 'robot12_joint_EA_Z',
        'robot12_joint_1', 'robot12_joint_2', 'robot12_joint_3', 'robot12_joint_4', 'robot12_joint_5', 'robot12_joint_6',
        'bridge2_joint_EA_X',
        'robot21_joint_EA_Y', 'robot21_joint_EA_Z',
        'robot21_joint_1', 'robot21_joint_2', 'robot21_joint_3', 'robot21_joint_4', 'robot21_joint_5', 'robot21_joint_6',
        'robot22_joint_EA_Y', 'robot22_joint_EA_Z',
        'robot22_joint_1', 'robot22_joint_2', 'robot22_joint_3', 'robot22_joint_4', 'robot22_joint_5', 'robot22_joint_6'
        )
    )

c = start_full_configuration.scaled(1e-3)
# ---------- end python_script ----------
list_item = ListItem(List=python_script.out, Index=0, Wrap=True)  # -> Item, Item1
configurations_at_pickup = Data(python_script.c)
mesh = Mesh()

# ----
# Visualisation
value_list = ValueList({"forward_kinematics": 0, "inverse_kinematics": 1, "calculated_path": 2}, selected="forward_kinematics")
stream_filter = StreamFilter(Gate=value_list, Stream0=configurations_at_pickup)
show_end_effector_frame = BooleanToggle(True)
show_base_frame = BooleanToggle(True)
show_collision = BooleanToggle(True)
show_frames = BooleanToggle(True)
show_visual = BooleanToggle(False)
visualize = PythonScript(
    robot=robot,
    configuration=stream_filter,
    show_visual=show_visual,
    show_collision=show_collision,
    show_frames=show_frames,
    show_base_frame=show_base_frame,
    show_end_effector_frame=show_end_effector_frame)  # -> visual, collision, frames, ee_frame, base_frame
# ---------- visualize: Python ----------
"""Visualizes a robot.
    Inputs:
        robot: The robot
        configuration: :class:`compas_fab.robots.Configuration`
            The robot's full configuration to display.
        show_visual: bool
           Whether or not to show the robot's visual meshes.
        show_collision: bool
           Whether or not to show the robot's collision meshes.
        show_frames: bool
           Whether or not to show the robot's joint frames.
        show_base_frame: bool
           Whether or not to show the robot's base frame.
        show_end_effector_frame: bool
            Whether or not to show the robot's end-effector frame.
    Output:
        visual: The robot's visual meshes.
        collision: The robot's collision meshes.
        frames: The robot's joint frames.
        base_frame: The robot's base frame.
        ee_frame: The robot's end-effector frame.
"""
from __future__ import print_function

if robot and configuration:
#    configuration.joint_names = robot.get_configurable_joint_names()
    robot.artist.update(configuration, visual=show_visual, collision=show_collision)
    
    joint_state = dict(zip(configuration.joint_names, configuration.values))
    
    print(joint_state)

    if show_visual:
        visual = robot.artist.draw_visual()

    if show_collision:
        collision = robot.artist.draw_collision()

    if show_frames:
        axes = robot.transformed_axes(joint_state)
        frames = robot.transformed_frames(joint_state)

    if show_base_frame:
        frames = robot.transformed_frames(joint_state)
        base_frame = frames[0]

    if show_end_effector_frame:
        ee_frame = robot.forward_kinematics(joint_state)
        print("End-effector", ee_frame)
# ---------- end visualize ----------
geometry = Geometry(visualize.collision)
geometry_2 = Geometry(visualize.visual)
draw = GhPythonScript(frames=[visualize.frames, visualize.ee_frame, visualize.base_frame], scale=Slider(0.1, range=0..1))  # -> P, V, C, W, flatten(planes); inputs frames: list
# ---------- draw: Python ----------
from System.Drawing import Color
from compas_ghpython import draw_frame

red = Color.FromArgb(255, 0, 0)
green = Color.FromArgb(0, 255, 0)
blue = Color.FromArgb(0, 0, 255)

P = []
V = []
C = []
planes = []

scale = float(scale)

for frame in frames:
    if not frame:
        continue
    plane = draw_frame(frame)
    P += [plane.Origin] * 3
    V.append(plane.XAxis * scale)
    V.append(plane.YAxis * scale)
    V.append(plane.ZAxis * scale)
    C += [red, green, blue]
    planes.append(plane)

W = 3
# ---------- end draw ----------
vector_display_ex = VectorDisplayEx(Point=draw.P, Vector=draw.V, Colour=draw.C, Width=draw.W)

list_item_2 = ListItem(List=visualize.frames, Index=Slider(21, range=0..43), Wrap=True)
ghpython_script_2 = GhPythonScript(x=list_item_2)  # -> out, a
# ---------- ghpython_script_2: Python ----------
from compas_ghpython import draw_frame

a = draw_frame(x)
# ---------- end ghpython_script_2 ----------
xy_plane = XYPlane(Origin=Point(0, 0, 0))
plane = Plane(ghpython_script_2.a)
scale = Scale(Geometry=plane, Center=Point(0, 0, 0), Factor="1e3")  # -> Geometry, Transform
orient = Orient(Geometry=mesh, Source=xy_plane, Target=scale.Geometry)  # -> Geometry, Transform
scale_2 = Scale(Geometry=[geometry_2, geometry], Center=Point(0, 0, 0), Factor="1e3")  # -> Geometry, Transform
